vi "Index.gviweb"   [LabVIEW NXG 3.1.0]
panel controls:
  "C++ Source": string
  "Compile": bool
  "Run": bool
  "Result name": string = "B"
  "plot result": bool
  "Input name": string = "X"
  "Num rand pts": f64 = 100
  "Set input": bool
  "Examples": i32 = "Loading..."(0)
panel indicators:
  "Result": f64[]
  "Output": error
uses:
  CIB::CIB.jsli::CreateCompiler
  CIB::CIB.jsli::CreateRuntime
  WebApp::Examples.gviweb
  CIB::CIB.jsli::ExecuteCompiler
  CIB::CIB.jsli::ExecuteRuntime
  CIB::CIB.jsli::GetSavedResult
  CIB::CIB.jsli::SetInputValue
diagram:
  call "PanelController.gviweb"(panel action="Initialize", run=reference to "Run", compile=reference to "Compile") -> (error out=w1)
  call "PanelController.gviweb"(panel action="Disable Buttons", error in=w1) -> (error out=w2)
  call "CreateCompiler"(error in=w2) -> (compiler refnum=w3, error out=w4)
  call "CreateRuntime"(error in=w2) -> (runtime refnum=w5, error out=w6)
  call "Examples.gviweb"() -> (Names=w7, Values=w8)
  Merge Errors(w4, w6) -> (error out=w9)
  Property Node(instance in=reference to "Examples", "Items"=w7, error in=w9) -> (error out=w10)
  call "PanelController.gviweb"(panel action="Enable Buttons", error in=w10) -> (error out=w11)
  s1 = u8[] []  # shift register
  while {
    event {
      on "Compile" Value changed {
        call "PanelController.gviweb"(panel action="Disable Buttons", error in=w11) -> (error out=w14)
        call "ExecuteCompiler"(compiler refnum=w3, source=$"C++ Source", error in=w14) -> (wasm=w12, error out=w15)
        call "PanelController.gviweb"(panel action="Enable Buttons", error in=w15) -> (error out=w13)
      }
      on "Run" Value changed {
        Array Size(array=s1) -> (size(s)=w16)
        Is Greater Than 0(x=w16) -> w17
        case (w17) {
          frame False, Default {
            One Button Dialog(message="Compilation not available")
            w13 = w11
          }
          frame True {
            call "PanelController.gviweb"(panel action="Disable Buttons", error in=w11) -> (error out=w18)
            call "ExecuteRuntime"(runtime refnum=w5, wasm=s1, error in=w18) -> (error out=w19)
            call "PanelController.gviweb"(panel action="Enable Buttons", error in=w19) -> (error out=w13)
          }
        }
        w12 = s1
      }
      on "Examples" Value changed {
        Array Index(array=w8) -> (out0[$Examples]=w20)
        $"C++ Source" <- w20
        w12 = u8[] []
        w13 = w11
      }
      on "plot result" Value changed {
        call "PanelController.gviweb"(panel action="Disable Buttons", error in=w11) -> (error out=w21)
        call "GetSavedResult"(runtime refnum=w5, name=$"Result name", error in=w21) -> (return=w22, error out=w23)
        call "PanelController.gviweb"(panel action="Enable Buttons", error in=w23) -> (error out=w13)
        $Result <- w22
        w12 = s1
      }
      on "Set input" Value changed {
        w24 = $"Num rand pts"
        for (N = w24) {
          Random Number() -> (number (0 to 1)=w26)
          append w26 to w25
        }
        call "PanelController.gviweb"(panel action="Disable Buttons", error in=w11) -> (error out=w27)
        call "SetInputValue"(runtime refnum=w5, name=$"Input name", value=w25, error in=w27) -> (error out=w28)
        call "PanelController.gviweb"(panel action="Enable Buttons", error in=w28) -> (error out=w13)
        w12 = s1
      }
    }
    $Output <- w13
    next s1 = w12
    stop if w13
  }
